# Grasshopper definition GrasshopperToMagicaVoxelConverter.gh (Grasshopper 1.0.7)

path = FilePath("D:\CloudStorage\OneDrive - Personal\OneDrive\Desktop\")
brep = Brep(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)
path_2 = FilePath("D:\ExternalProgrammes\FileToVox-v1.9.2\FileToVox.exe")
c_script = CSharpScript(geom=brep, filename="sample2", dir=path, export=Toggle(False), MVexe=path_2)  # inputs geom: GeometryBase, filename: String, dir: String, export: Boolean, MVexe: String
# ---------- c_script: C# usings ----------
using System.IO;
using System.Linq;
using System.Data;
using System.Drawing;
using System.Reflection;
using System.Windows.Forms;
using System.Xml;
using System.Xml.Linq;
using System.Runtime.InteropServices;

using Rhino.DocObjects;
using Rhino.Collections;
using GH_IO;
using GH_IO.Serialization;
# ---------- c_script: C# ----------
    if(export){

      var guid = Rhino.RhinoDoc.ActiveDoc.Objects.Add(geom);
      Rhino.RhinoDoc.ActiveDoc.Objects.Select(guid);

      string filepath = Path.Combine(dir, filename);

      string cmd = "_-Export " + " \"" + filename + ".obj" + "\"" + " _Enter _Enter";
      Rhino.RhinoApp.RunScript(cmd, true);
      Rhino.RhinoDoc.ActiveDoc.Objects.Delete(guid, true);

      // command to save the mv file
      string command = "/C " + "\"" + "\"" + MVexe + "\"" + " --i " + "\"" + filepath + ".obj" + "\"" + " --o " + "\"" + filepath + "\"";
      System.Diagnostics.Process.Start("CMD.exe", command);
    }
# ---------- end c_script ----------
